# Grasshopper definition GettingStartedWithPandas_001.gh (Grasshopper 1.0.7)
# plug-ins: Hops

hardcode = Panel("['b', 'a', 'd']")
# auto_align_01
panel = Panel("4")
# exponential_function_03
number_slider = Slider(4, range=0..10)
# Getting Started with Pandas
# into Grasshopper for Rhino3D
# at www.wickersonstudios.com
# Series
# /series_05
number_slider_2 = Slider(1, range=0..10)
# /series_13
number_slider_3 = Slider(10, range=0..10)
series = Series(Start=0, Step=1, Count="4")
hardcode_2 = Panel("b")
# missing_data_01
# pd.isnull
series_2 = Series(Start=0, Step=1, Count=panel)
# name_attribute_01
series_3 = Series(Start=0, Step=1, Count="4")
# dict_04
series_4 = Series(Start=0, Step=1, Count="4")
# series_identifier_01
panel_2 = Panel("4")
# dict_03
series_5 = Series(Start=0, Step=1, Count=10)
# index_alteration_01
series_6 = Series(Start=0, Step=Slider(4, range=0..10), Count="4")
panel_3 = Panel("""a
b
c
d""")
series_7 = Series(Start=0, Step=Slider(4, range=0..10), Count="4")
# boolean_filter_13
series_8 = Series(Start=0, Step=Slider(4, range=0..10), Count="4")
panel_4 = Panel("""a
b
c
d""")
# set_of_values_02
series_9 = Series(Start=0, Step=Slider(3, range=0..10), Count="4")
panel_5 = Panel("""a
b
c
d""")
panel_6 = Panel("""a
b
c
d""")
# fixed_length_04
series_10 = Series(Start=0, Step=Slider(4, range=0..10), Count="4")
series_11 = Series(Start=0, Step=1, Count=panel_2)
# /single_value_011
series_12 = Series(Start=0, Step=Slider(3, range=0..10), Count="4")
series_13 = Series(Start=0, Step=1, Count=10)
panel_7 = Panel("""a
b
c
d""")
panel_8 = Panel("""a
b
c
d""")
panel_9 = Panel("""a
b
c
d""")
panel_10 = Panel("""a
b
c
d""")
panel_11 = Panel("""a
b
c
d""")
panel_12 = Panel("""a
b
c
d""")
auto_align_01 = Hops(
    Series=series,
    Index=panel_3,
    CacheResultsInMemory=True,
    CacheSolveResults=True,
    RemoteDefinitionLocation="http://127.0.0.1:5000/auto_align_01",
    RemoteSolveVersion=(0, 1, 0),
    ShowInput_Enabled=False,
    ShowInput_Path=False,
    SynchronousSolve=True)
missing_data_01 = Hops(
    Series=series_2,
    CacheResultsInMemory=True,
    CacheSolveResults=True,
    RemoteDefinitionLocation="http://127.0.0.1:5000/missing_data_01",
    RemoteSolveVersion=(0, 1, 0),
    ShowInput_Enabled=False,
    ShowInput_Path=False,
    SynchronousSolve=True)
dict_04 = Hops(
    Series=series_4,
    Index=panel_5,
    CacheResultsInMemory=False,
    CacheSolveResults=False,
    RemoteDefinitionLocation="http://127.0.0.1:5000/dict_04",
    RemoteSolveVersion=(0, 1, 0),
    ShowInput_Enabled=False,
    ShowInput_Path=False,
    SynchronousSolve=True)
dict_03 = Hops(
    Series=series_5,
    CacheResultsInMemory=True,
    CacheSolveResults=True,
    RemoteDefinitionLocation="http://127.0.0.1:5000/dict_03",
    RemoteSolveVersion=(0, 1, 0),
    ShowInput_Enabled=False,
    ShowInput_Path=False,
    SynchronousSolve=True)
index_alteration_01 = Hops(
    Series=series_6,
    Index=panel_6,
    CacheResultsInMemory=False,
    CacheSolveResults=False,
    RemoteDefinitionLocation="http://127.0.0.1:5000/index_alteration_01",
    RemoteSolveVersion=(0, 1, 0),
    ShowInput_Enabled=False,
    ShowInput_Path=False,
    SynchronousSolve=True)
name_attribute_01 = Hops(
    Series=series_3,
    Index=panel_4,
    CacheResultsInMemory=True,
    CacheSolveResults=True,
    RemoteDefinitionLocation="http://127.0.0.1:5000/name_attribute_01",
    RemoteSolveVersion=(0, 1, 0),
    ShowInput_Enabled=False,
    ShowInput_Path=False,
    SynchronousSolve=True)
boolean_filter_13 = Hops(
    Series=series_8,
    Index=panel_8,
    HigherThan=number_slider,
    CacheResultsInMemory=True,
    CacheSolveResults=True,
    RemoteDefinitionLocation="http://127.0.0.1:5000/boolean_filter_13",
    RemoteSolveVersion=(0, 1, 0),
    ShowInput_Enabled=False,
    ShowInput_Path=False,
    SynchronousSolve=True)
# Instructions:
# 1. Drag and drop a hops node on the canvas.
# 2. Set path to:
# http://127.0.0.1:5000/exponential_function_03
# 3. Name and toggle  component name to :
# exponential_function_03
panel_13 = Panel(series_7)
fixed_length_04 = Hops(
    Series=series_10,
    Index=panel_10,
    CacheResultsInMemory=True,
    CacheSolveResults=True,
    RemoteDefinitionLocation="http://127.0.0.1:5000/fixed_length_04",
    RemoteSolveVersion=(0, 1, 0),
    ShowInput_Enabled=False,
    ShowInput_Path=False,
    SynchronousSolve=True)
set_of_values_02 = Hops(
    Series=series_9,
    Index=panel_9,
    CacheResultsInMemory=True,
    CacheSolveResults=True,
    RemoteDefinitionLocation="http://127.0.0.1:5000/set_of_values_02",
    RemoteSolveVersion=(0, 1, 0),
    ShowInput_Enabled=False,
    ShowInput_Path=False,
    SynchronousSolve=True)
# Instructions:
# 1. Drag and drop a hops node on the canvas.
# 2. Set path to:
# http://127.0.0.1:5000/boolean_filter_13
# 3. Name and toggle  component name to :
# boolean_filter_13
panel_14 = Panel(series_8)
# Instructions:
# 1. Drag and drop a hops node on the canvas.
# 2. Set path to:
# http://127.0.0.1:5000/fixed_length_04
# 3. Name and toggle  component name to :
# fixed_length_04
panel_15 = Panel(series_10)
# Instructions:
# 1. Drag and drop a hops node on the canvas.
# 2. Set path to:
# http://127.0.0.1:5000/series_identifier_01
# 3. Name and toggle  component name to :
# series_identifier_01
series_identifier_01 = Hops(
    Item=series_11,
    Index=panel_12,
    CacheResultsInMemory=True,
    CacheSolveResults=True,
    RemoteDefinitionLocation="http://127.0.0.1:5000/series_identifier_01",
    RemoteSolveVersion=(0, 1, 0),
    ShowInput_Enabled=False,
    ShowInput_Path=False,
    SynchronousSolve=True)  # -> Series, Values, Index
exponential_function_03 = Hops(
    Series=series_7,
    Index=panel_7,
    CacheResultsInMemory=True,
    CacheSolveResults=True,
    RemoteDefinitionLocation="http://127.0.0.1:5000/exponential_function_03",
    RemoteSolveVersion=(0, 1, 0),
    ShowInput_Enabled=False,
    ShowInput_Path=False,
    SynchronousSolve=True)
# Instructions:
# 1. Drag and drop a hops node on the canvas.
# 2. Set path to:
# http://127.0.0.1:5000/series_13
# 3. Name and toggle  component name to :
# series_13
series_13_2 = Hops(
    List=series_13,
    CacheResultsInMemory=True,
    CacheSolveResults=True,
    RemoteDefinitionLocation="http://127.0.0.1:5000/series_13",
    RemoteSolveVersion=(0, 1, 0),
    ShowInput_Enabled=False,
    ShowInput_Path=False,
    SynchronousSolve=True)  # -> Series, Values, Index
# Instructions:
# 1. Drag and drop a hops node on the canvas.
# 2. Set path to:
# http://127.0.0.1:5000/set_of_values_02
# 3. Name and toggle  component name to :
# set_of_values_02
panel_16 = Panel(series_9)
single_value_11 = Hops(
    Series=series_12,
    Index=panel_11,
    CacheResultsInMemory=True,
    CacheSolveResults=True,
    RemoteDefinitionLocation="http://127.0.0.1:5000/single_value_11",
    RemoteSolveVersion=(0, 1, 0),
    ShowInput_Enabled=False,
    ShowInput_Path=False,
    SynchronousSolve=True)
# Instructions:
# 1. Drag and drop a hops node on the canvas.
# 2. Set path to:
# http://127.0.0.1:5000/series_05
# 3. Name and toggle  component name to :
# series_05
series_05 = Hops(
    A=number_slider_2,
    B=Slider(5, range=0..10),
    C=Slider(6, range=0..10),
    D=number_slider_3,
    CacheResultsInMemory=True,
    CacheSolveResults=True,
    RemoteDefinitionLocation="http://127.0.0.1:5000/series_05",
    RemoteSolveVersion=(0, 1, 0),
    ShowInput_Enabled=False,
    ShowInput_Path=False,
    SynchronousSolve=True)
# Instructions:
# 1. Drag and drop a hops node on the canvas.
# 2. Set path to:
# http://127.0.0.1:5000/single_value_011
# 3. Name and toggle  component name to :
# single_value_011
panel_17 = Panel(series_12)
# Instructions:
# 1. Drag and drop a hops node on the canvas.
# 2. Set path to:
# http://127.0.0.1:5000/auto_align_01
# 3. Name and toggle  component name to :
# auto_align_01
panel_18 = Panel(auto_align_01)
# Instructions:
# 1. Drag and drop a hops node on the canvas.
# 2. Set path to:
# http://127.0.0.1:5000/missing_data_01
# 3. Name and toggle  component name to :
# missing_data_01
panel_19 = Panel(missing_data_01)
# Instructions:
# 1. Drag and drop a hops node on the canvas.
# 2. Set path to:
# http://127.0.0.1:5000/dict_04
# 3. Name and toggle  component name to :
# dict_04
panel_20 = Panel(dict_04)
# Instructions:
# 1. Drag and drop a hops node on the canvas.
# 2. Set path to:
# http://127.0.0.1:5000/name_attribute_01
# 3. Name and toggle  component name to :
# name_attribute_01
panel_21 = Panel(name_attribute_01)
# Instructions:
# 1. Drag and drop a hops node on the canvas.
# 2. Set path to:
# http://127.0.0.1:5000/dict_03
# 3. Name and toggle  component name to :
# dict_03
panel_22 = Panel(dict_03)
# Instructions:
# 1. Drag and drop a hops node on the canvas.
# 2. Set path to:
# http://127.0.0.1:5000/index_alteration_01
# 3. Name and toggle  component name to :
# index_alteration_01
panel_23 = Panel(index_alteration_01)
panel_24 = Panel(fixed_length_04)
panel_25 = Panel(series_identifier_01.Series)
panel_26 = Panel(set_of_values_02)
panel_27 = Panel(series_13_2.Series)
panel_28 = Panel(exponential_function_03)
panel_29 = Panel(single_value_11)
panel_30 = Panel(series_identifier_01.Index)
panel_31 = Panel(boolean_filter_13)
panel_32 = Panel(series_05)
panel_33 = Panel(series_identifier_01.Values)
panel_34 = Panel(series_13_2.Values)
panel_35 = Panel(series_13_2.Index)
index = Slider(6, range=0..10)
index_2 = Slider(6, range=0..10)
# dot_attribute_notation_01
panel_36 = Panel("10")
# iloc_method_01
panel_37 = Panel("10")
# column_not_contained_01
panel_38 = Panel("1999")
# sequence_of_columns_01
panel_39 = Panel("1999")
# modify_columns_05
index_3 = Slider(0, range=0..10)
series_14 = Series(Start=panel_38, Step=1, Count="10")
# modify_columns_NAN_01
series_15 = Series(Start=0, Step=1, Count=index)
series_16 = Series(Start=0, Step=1, Count="10")
series_17 = Series(Start="1999", Step=1, Count=index)
series_18 = Series(Start=Slider(10, range=0..10), Step=Slider(62.4, range=0..100), Count=index)
series_19 = Series(Start=Slider(2, range=0..10), Step=Slider(0.5, range=0..1), Count="10")
# dictionary_type_notation_03
series_20 = Series(Start=0, Step=1, Count=panel_36)
series_21 = Series(Start=0, Step=1, Count=index_2)
series_22 = Series(Start="1999", Step=1, Count=panel_36)
series_23 = Series(Start=Slider(10, range=0..10), Step=Slider(62.4, range=0..100), Count=panel_36)
series_24 = Series(Start="1999", Step=1, Count=index_2)
series_25 = Series(Start=Slider(10, range=0..10), Step=Slider(62.4, range=0..100), Count=index_2)
series_26 = Series(Start=0, Step=1, Count=panel_37)
series_27 = Series(Start="1999", Step=1, Count=panel_37)
series_28 = Series(Start=Slider(10, range=0..10), Step=Slider(62.4, range=0..100), Count=panel_37)
series_29 = Series(Start=0, Step=1, Count="10")
series_30 = Series(Start=panel_39, Step=1, Count="10")
series_31 = Series(Start="1999", Step=1, Count="10")
series_32 = Series(Start=Slider(10, range=0..10), Step=Slider(62.4, range=0..100), Count="10")
series_33 = Series(Start=0, Step=1, Count="10")
series_34 = Series(Start=Slider(2, range=0..10), Step=Slider(0.5, range=0..1), Count="10")
series_35 = Series(Start="1999", Step=1, Count="10")
series_36 = Series(Start=0, Step=1, Count="10")
series_37 = Series(Start=Slider(2, range=0..10), Step=Slider(0.5, range=0..1), Count="10")
series_38 = Series(Start="1999", Step=1, Count="10")
# DataFrame
# dataframe_02
# pandas
series_39 = Series(Start=0, Step=1, Count=10)
series_40 = Series(Start=0, Step=1, Count="10")
# tail_method_01
series_41 = Series(Start=Slider(2, range=0..10), Step=Slider(0.5, range=0..1), Count="10")
# dataframe_03b
series_42 = Series(Start="1999", Step=1, Count="10")
series_43 = Series(Start=0, Step=1, Count="10")
series_44 = Series(Start="1999", Step=1, Count="10")
# head_method_06
series_45 = Series(Start=Slider(2, range=0..10), Step=Slider(0.5, range=0..1), Count="10")
series_46 = Series(Start=0, Step=1, Count="10")
# head_method_07
series_47 = Series(Start=Slider(2, range=0..10), Step=Slider(0.5, range=0..1), Count="10")
# Instructions:
# 1. Drag and drop a hops node on the canvas.
# 2. Set path to:
# http://127.0.0.1:5000/modify_columns_NAN_01
# 3. Name and toggle  component name to :
# modify_columns_NAN_01
modify_columns_nan_01 = Hops(
    StateNum=series_15,
    Year=series_17,
    Pop=series_18,
    Index=index,
    CacheResultsInMemory=True,
    CacheSolveResults=True,
    RemoteDefinitionLocation="http://127.0.0.1:5000/modify_columns_NAN_01",
    RemoteSolveVersion=(0, 1, 0),
    ShowInput_Enabled=False,
    ShowInput_Path=False,
    SynchronousSolve=True)
# Instructions:
# 1. Drag and drop a hops node on the canvas.
# 2. Set path to:
# http://127.0.0.1:5000/iloc_method_01
# 3. Name and toggle  component name to :
# iloc_method_01
hops = Hops(
    StateNum=series_29,
    Year=series_31,
    Pop=series_32,
    Index=index_3,
    CacheResultsInMemory=False,
    CacheSolveResults=False,
    RemoteDefinitionLocation="http://127.0.0.1:5000/iloc_method_02",
    RemoteSolveVersion=(0, 1, 0),
    ShowInput_Enabled=False,
    ShowInput_Path=False,
    SynchronousSolve=True)
dataframe_02 = Hops(
    State=series_39,
    Year=series_39,
    Pop=series_39,
    CacheResultsInMemory=True,
    CacheSolveResults=True,
    RemoteDefinitionLocation="http://127.0.0.1:5000/dataframe_02",
    RemoteSolveVersion=(0, 1, 0),
    ShowInput_Enabled=False,
    ShowInput_Path=False,
    SynchronousSolve=True)
# Instructions:
# 1. Drag and drop a hops node on the canvas.
# 2. Set path to:
# http://127.0.0.1:5000/modify_columns_05
# 3. Name and toggle  component name to :
# modify_columns_05
modify_columns_05 = Hops(
    StateNum=series_21,
    Year=series_24,
    Pop=series_25,
    Index=index_2,
    CacheResultsInMemory=True,
    CacheSolveResults=True,
    RemoteDefinitionLocation="http://127.0.0.1:5000/modify_columns_05",
    RemoteSolveVersion=(0, 1, 0),
    ShowInput_Enabled=False,
    ShowInput_Path=False,
    SynchronousSolve=True)  # -> DF1, DF2, DF3, DF4, DF5
# Instructions:
# 1. Drag and drop a hops node on the canvas.
# 2. Set path to:
# http://127.0.0.1:5000/column_not_contained_01
# 3. Name and toggle  component name to :
# column_not_contained_01
column_not_contained_01 = Hops(
    State=series_14,
    Year=series_16,
    Pop=series_19,
    CacheResultsInMemory=True,
    CacheSolveResults=True,
    RemoteDefinitionLocation="http://127.0.0.1:5000/column_not_contained_01",
    RemoteSolveVersion=(0, 1, 0),
    ShowInput_Enabled=False,
    ShowInput_Path=False,
    SynchronousSolve=True)  # -> DF1, DF2, DF3, DF4, DF5
# Instructions:
# 1. Drag and drop a hops node on the canvas.
# 2. Set path to:
# http://127.0.0.1:5000/dictionary_type_notation_03
# 3. Name and toggle  component name to :
# dictionary_type_notation_03
dictionary_type_notation_03 = Hops(
    State=series_20,
    Year=series_22,
    Pop=series_23,
    CacheResultsInMemory=False,
    CacheSolveResults=False,
    RemoteDefinitionLocation="http://127.0.0.1:5000/dictionary_type_notation_03",
    RemoteSolveVersion=(0, 1, 0),
    ShowInput_Enabled=False,
    ShowInput_Path=False,
    SynchronousSolve=True)
# Instructions:
# 1. Drag and drop a hops node on the canvas.
# 2. Set path to:
# http://127.0.0.1:5000/dot_attribute_notation_01
# 3. Name and toggle  component name to :
# dot_attribute_notation_01
dot_attribute_notation_01 = Hops(
    State=series_26,
    Year=series_27,
    Pop=series_28,
    CacheResultsInMemory=True,
    CacheSolveResults=True,
    RemoteDefinitionLocation="http://127.0.0.1:5000/dot_attribute_notation_01",
    RemoteSolveVersion=(0, 1, 0),
    ShowInput_Enabled=False,
    ShowInput_Path=False,
    SynchronousSolve=True)
hops_2 = Hops(
    State=series_42,
    Year=series_43,
    Pop=series_45,
    CacheResultsInMemory=True,
    CacheSolveResults=True,
    RemoteDefinitionLocation="http://127.0.0.1:5000/dataframe_03b",
    RemoteSolveVersion=(0, 1, 0),
    ShowInput_Enabled=False,
    ShowInput_Path=False,
    SynchronousSolve=True)  # -> DF1, DF2, DF3
head_method_06 = Hops(
    State=series_44,
    Year=series_46,
    Pop=series_47,
    CacheResultsInMemory=True,
    CacheSolveResults=True,
    RemoteDefinitionLocation="http://127.0.0.1:5000/head_method_06",
    RemoteSolveVersion=(0, 1, 0),
    ShowInput_Enabled=False,
    ShowInput_Path=False,
    SynchronousSolve=True)
# Instructions:
# 1. Drag and drop a hops node on the canvas.
# 2. Set path to:
# http://127.0.0.1:5000/tail_method_01
# 3. Name and toggle  component name to :
# tail_method_01
tail_method_01 = Hops(
    State=series_35,
    Year=series_36,
    Pop=series_37,
    CacheResultsInMemory=True,
    CacheSolveResults=True,
    RemoteDefinitionLocation="http://127.0.0.1:5000/tail_method_01",
    RemoteSolveVersion=(0, 1, 0),
    ShowInput_Enabled=False,
    ShowInput_Path=False,
    SynchronousSolve=True)  # -> DF1, DF2, DF3, DF4, DF5
# Instructions:
# 1. Drag and drop a hops node on the canvas.
# 2. Set path to:
# http://127.0.0.1:5000/head_method_07
# 3. Name and toggle  component name to :
# head_method_07
head_method_07 = Hops(
    State=series_38,
    Year=series_40,
    Pop=series_41,
    CacheResultsInMemory=True,
    CacheSolveResults=True,
    RemoteDefinitionLocation="http://127.0.0.1:5000/head_method_07",
    RemoteSolveVersion=(0, 1, 0),
    ShowInput_Enabled=False,
    ShowInput_Path=False,
    SynchronousSolve=True)  # -> DF1, DF2, DF3, DF4, DF5
# Instructions:
# 1. Drag and drop a hops node on the canvas.
# 2. Set path to:
# http://127.0.0.1:5000/sequence_of_columns_01
# 3. Name and toggle  component name to :
# sequence_of_columns_01
sequence_of_columns_01 = Hops(
    State=series_30,
    Year=series_33,
    Pop=series_34,
    CacheResultsInMemory=True,
    CacheSolveResults=True,
    RemoteDefinitionLocation="http://127.0.0.1:5000/sequence_of_columns_01",
    RemoteSolveVersion=(0, 1, 0),
    ShowInput_Enabled=False,
    ShowInput_Path=False,
    SynchronousSolve=True)  # -> DF1, DF2, DF3, DF4, DF5
panel_40 = Panel(dot_attribute_notation_01)
panel_41 = Panel(hops)
panel_42 = Panel(modify_columns_nan_01)
entwine = Entwine(
    Branch00=column_not_contained_01.DF1,
    Branch01=column_not_contained_01.DF2,
    Branch02=column_not_contained_01.DF3,
    Branch03=column_not_contained_01.DF4,
    Branch04=column_not_contained_01.DF5,
    FlattenInputs=True)
# Instructions:
# 1. Drag and drop a hops node on the canvas.
# 2. Set path to:
# http://127.0.0.1:5000/dataframe_03
# 3. Name and toggle  component name to :
# dataframe_03
entwine_2 = Entwine(Branch00=hops_2.DF1, Branch01=hops_2.DF2, Branch02=hops_2.DF3, FlattenInputs=True)
entwine_3 = Entwine(
    Branch00=sequence_of_columns_01.DF1,
    Branch01=sequence_of_columns_01.DF2,
    Branch02=sequence_of_columns_01.DF3,
    Branch03=sequence_of_columns_01.DF4,
    Branch04=sequence_of_columns_01.DF5,
    FlattenInputs=True)
# Instructions:
# 1. Drag and drop a hops node on the canvas.
# 2. Set path to:
# http://127.0.0.1:5000/head_method_06
# 3. Name and toggle  component name to :
# head_method_06
panel_43 = Panel(head_method_06)
# Instructions:
# 1. Drag and drop a hops node on the canvas.
# 2. Set path to:
# http://127.0.0.1:5000/dataframe_02
# 3. Name and toggle  component name to :
# dataframe_02
panel_44 = Panel(dataframe_02)
panel_45 = Panel(dictionary_type_notation_03)
entwine_4 = Entwine(
    Branch00=tail_method_01.DF1,
    Branch01=tail_method_01.DF2,
    Branch02=tail_method_01.DF3,
    Branch03=tail_method_01.DF4,
    Branch04=tail_method_01.DF5,
    FlattenInputs=True)
entwine_5 = Entwine(
    Branch00=head_method_07.DF1,
    Branch01=head_method_07.DF2,
    Branch02=head_method_07.DF3,
    Branch03=head_method_07.DF4,
    Branch04=head_method_07.DF5,
    FlattenInputs=True)
entwine_6 = Entwine(
    Branch00=modify_columns_05.DF1,
    Branch01=modify_columns_05.DF2,
    Branch02=modify_columns_05.DF3,
    Branch03=modify_columns_05.DF4,
    Branch04=modify_columns_05.DF5,
    FlattenInputs=True)
panel_46 = Panel(entwine_2)
panel_47 = Panel(entwine_6)
panel_48 = Panel(entwine)
panel_49 = Panel(entwine_3)
panel_50 = Panel(entwine_4)
panel_51 = Panel(entwine_5)
# keys_in_inner_dicts_01
index_4 = Slider(6, range=0..10)
# nested_dicts_02
index_5 = Slider(6, range=0..10)
index_6 = Slider(6, range=0..10)
# dicts_of_series_01
boolean_toggle = BooleanToggle(True)
# data_inputs_01
boolean_toggle_2 = BooleanToggle(True)
# to_numpy_01
boolean_toggle_3 = BooleanToggle(True)
series_48 = Series(Start="1999", Step=1, Count=index_4)
# transpose_01
series_49 = Series(Start=0, Step=1, Count=index_4)
series_50 = Series(Start=Slider(10, range=0..10), Step=Slider(62.4, range=0..100), Count=index_4)
series_51 = Series(Start="1999", Step=1, Count=index_5)
# copy_method_01
series_52 = Series(Start=0, Step=1, Count=index_5)
series_53 = Series(Start="1999", Step=1, Count=index_6)
series_54 = Series(Start=Slider(10, range=0..10), Step=Slider(62.4, range=0..100), Count=index_5)
# del_method_01
series_55 = Series(Start=0, Step=1, Count=index_6)
series_56 = Series(Start=Slider(10, range=0..10), Step=Slider(62.4, range=0..100), Count=index_6)
# Instructions:
# 1. Drag and drop a hops node on the canvas.
# 2. Set path to:
# http://127.0.0.1:5000/keys_in_inner_dicts_01
# 3. Name and toggle  component name to :
# keys_in_inner_dicts_01
keys_in_inner_dicts_01 = Hops(
    Toggle=boolean_toggle,
    CacheResultsInMemory=True,
    CacheSolveResults=True,
    RemoteDefinitionLocation="http://127.0.0.1:5000/keys_in_inner_dicts_01",
    RemoteSolveVersion=(0, 1, 0),
    ShowInput_Enabled=False,
    ShowInput_Path=False,
    SynchronousSolve=True)
# Instructions:
# 1. Drag and drop a hops node on the canvas.
# 2. Set path to:
# http://127.0.0.1:5000/nested_dicts_02
# 3. Name and toggle  component name to :
# nested_dicts_02
nested_dicts_02 = Hops(
    Toggle=Toggle(True),
    CacheResultsInMemory=True,
    CacheSolveResults=True,
    RemoteDefinitionLocation="http://127.0.0.1:5000/nested_dicts_02",
    RemoteSolveVersion=(0, 1, 0),
    ShowInput_Enabled=False,
    ShowInput_Path=False,
    SynchronousSolve=True)  # -> DF1, DF2, DF3
# Instructions:
# 1. Drag and drop a hops node on the canvas.
# 2. Set path to:
# http://127.0.0.1:5000/data_inputs_01
# 3. Name and toggle  component name to :
# data_inputs_01
data_inputs_01 = Hops(
    Toggle=boolean_toggle_3,
    CacheResultsInMemory=True,
    CacheSolveResults=True,
    RemoteDefinitionLocation="http://127.0.0.1:5000/data_inputs_01",
    RemoteSolveVersion=(0, 1, 0),
    ShowInput_Enabled=False,
    ShowInput_Path=False,
    SynchronousSolve=True)
# Instructions:
# 1. Drag and drop a hops node on the canvas.
# 2. Set path to:
# http://127.0.0.1:5000/dicts_of_series_01
# 3. Name and toggle  component name to :
# dicts_of_series_01
dicts_of_series_01 = Hops(
    Toggle=boolean_toggle_2,
    CacheResultsInMemory=True,
    CacheSolveResults=True,
    RemoteDefinitionLocation="http://127.0.0.1:5000/dicts_of_series_01",
    RemoteSolveVersion=(0, 1, 0),
    ShowInput_Enabled=False,
    ShowInput_Path=False,
    SynchronousSolve=True)
# Instructions:
# 1. Drag and drop a hops node on the canvas.
# 2. Set path to:
# http://127.0.0.1:5000/del_method_03
# 3. Name and toggle  component name to :
# del_method_03
del_method_03 = Hops(
    StateNum=series_55,
    Year=series_53,
    Pop=series_56,
    Index=index_6,
    CacheResultsInMemory=True,
    CacheSolveResults=True,
    RemoteDefinitionLocation="http://127.0.0.1:5000/del_method_03",
    RemoteSolveVersion=(0, 1, 0),
    ShowInput_Enabled=False,
    ShowInput_Path=False,
    SynchronousSolve=True)
# Instructions:
# 1. Drag and drop a hops node on the canvas.
# 2. Set path to:
# http://127.0.0.1:5000/transpose_01
# 3. Name and toggle  component name to :
# transpose_01
transpose_01 = Hops(
    StateNum=series_49,
    Year=series_48,
    Pop=series_50,
    CacheResultsInMemory=True,
    CacheSolveResults=True,
    RemoteDefinitionLocation="http://127.0.0.1:5000/transpose_01",
    RemoteSolveVersion=(0, 1, 0),
    ShowInput_Enabled=False,
    ShowInput_Path=False,
    SynchronousSolve=True)
# Instructions:
# 1. Drag and drop a hops node on the canvas.
# 2. Set path to:
# http://127.0.0.1:5000/to_numpy_01
# 3. Name and toggle  component name to :
# to_numpy_01
to_numpy_01 = Hops(
    Toggle=Toggle(True),
    CacheResultsInMemory=True,
    CacheSolveResults=True,
    RemoteDefinitionLocation="http://127.0.0.1:5000/to_numpy_01",
    RemoteSolveVersion=(0, 1, 0),
    ShowInput_Enabled=False,
    ShowInput_Path=False,
    SynchronousSolve=True)
# Instructions:
# 1. Drag and drop a hops node on the canvas.
# 2. Set path to:
# http://127.0.0.1:5000/copy_method_01
# 3. Name and toggle  component name to :
# copy_method_01
copy_method_01 = Hops(
    StateNum=series_52,
    Year=series_51,
    Pop=series_54,
    Index=index_5,
    CacheResultsInMemory=True,
    CacheSolveResults=True,
    RemoteDefinitionLocation="http://127.0.0.1:5000/copy_method_01",
    RemoteSolveVersion=(0, 1, 0),
    ShowInput_Enabled=False,
    ShowInput_Path=False,
    SynchronousSolve=True)
panel_52 = Panel(dicts_of_series_01)
panel_53 = Panel(data_inputs_01)
panel_54 = Panel(keys_in_inner_dicts_01)
entwine_7 = Entwine(Branch00=nested_dicts_02.DF1, Branch01=nested_dicts_02.DF2, Branch02=nested_dicts_02.DF3, FlattenInputs=True)
panel_55 = Panel(to_numpy_01)
panel_56 = Panel(copy_method_01)
panel_57 = Panel(del_method_03)
panel_58 = Panel(transpose_01)
panel_59 = Panel(entwine_7)
# Index Objects
# index_objects_01
# index_objects_02
boolean_toggle_4 = BooleanToggle(False)
# index_objects_03
boolean_toggle_5 = BooleanToggle(True)
# Index methods and properties
boolean_toggle_6 = BooleanToggle(True)
# index_objects_08
boolean_toggle_7 = BooleanToggle(True)
boolean_toggle_8 = BooleanToggle(False)
# append_01
# difference_01
boolean_toggle_9 = BooleanToggle(False)
# Instructions:
# 1. Drag and drop a hops node on the canvas.
# 2. Set path to:
# http://127.0.0.1:5000/index_objects_01
# 3. Name and toggle  component name to :
# index_objects_01
index_objects_01 = Hops(
    Toggle=boolean_toggle_4,
    CacheResultsInMemory=True,
    CacheSolveResults=True,
    RemoteDefinitionLocation="http://127.0.0.1:5000/index_objects_01",
    RemoteSolveVersion=(0, 1, 0),
    ShowInput_Enabled=False,
    ShowInput_Path=False,
    SynchronousSolve=True)
# Instructions:
# 1. Drag and drop a hops node on the canvas.
# 2. Set path to:
# http://127.0.0.1:5000/index_objects_02
# 3. Name and toggle  component name to :
# index_objects_012
index_objects_02 = Hops(
    Toggle=boolean_toggle_5,
    CacheResultsInMemory=True,
    CacheSolveResults=True,
    RemoteDefinitionLocation="http://127.0.0.1:5000/index_objects_02",
    RemoteSolveVersion=(0, 1, 0),
    ShowInput_Enabled=False,
    ShowInput_Path=False,
    SynchronousSolve=True)
# Instructions:
# 1. Drag and drop a hops node on the canvas.
# 2. Set path to:
# http://127.0.0.1:5000/index_objects_08
# 3. Name and toggle  component name to :
# index_objects_08
index_objects_08 = Hops(
    Toggle=boolean_toggle_6,
    CacheResultsInMemory=True,
    CacheSolveResults=True,
    RemoteDefinitionLocation="http://127.0.0.1:5000/index_objects_08",
    RemoteSolveVersion=(0, 1, 0),
    ShowInput_Enabled=False,
    ShowInput_Path=False,
    SynchronousSolve=True)
# Instructions:
# 1. Drag and drop a hops node on the canvas.
# 2. Set path to:
# http://127.0.0.1:5000/index_objects_03
# 3. Name and toggle  component name to :
# index_objects_03
index_objects_03 = Hops(
    Toggle=boolean_toggle_7,
    CacheResultsInMemory=True,
    CacheSolveResults=True,
    RemoteDefinitionLocation="http://127.0.0.1:5000/index_objects_03",
    RemoteSolveVersion=(0, 1, 0),
    ShowInput_Enabled=False,
    ShowInput_Path=False,
    SynchronousSolve=True)  # -> Ohio_Output, _2003_Output
# Instructions:
# 1. Drag and drop a hops node on the canvas.
# 2. Set path to:
# http://127.0.0.1:5000/append_01
# 3. Name and toggle  component name to :
# append_01
hops_3 = Hops(
    Toggle=boolean_toggle_9,
    Index=boolean_toggle_9,
    CacheResultsInMemory=True,
    CacheSolveResults=True,
    RemoteDefinitionLocation="http://127.0.0.1:5000/append_01",
    RemoteSolveVersion=(0, 1, 0),
    ShowInput_Enabled=False,
    ShowInput_Path=False,
    SynchronousSolve=True)
# Instructions:
# 1. Drag and drop a hops node on the canvas.
# 2. Set path to:
# http://127.0.0.1:5000/difference_01
# 3. Name and toggle  component name to :
# difference_01
difference_01 = Hops(
    Toggle=boolean_toggle_8,
    Index=boolean_toggle_8,
    CacheResultsInMemory=True,
    CacheSolveResults=True,
    RemoteDefinitionLocation="http://127.0.0.1:5000/difference_01",
    RemoteSolveVersion=(0, 1, 0),
    ShowInput_Enabled=False,
    ShowInput_Path=False,
    SynchronousSolve=True)
panel_60 = Panel(index_objects_01)
panel_61 = Panel(index_objects_02)
panel_62 = Panel(index_objects_08)
panel_63 = Panel([index_objects_03.Ohio_Output, index_objects_03._2003_Output])
panel_64 = Panel(difference_01)
panel_65 = Panel(hops_3)
