# Grasshopper definition GettingStartedWithPandas_002b.gh (Grasshopper 1.0.7)
# plug-ins: Hops

# reindexing_ffill_03
panel = Panel("""100
200
300""")

# ----
# Be sure to use
# hopsNumber or
# hopsInteger
panel_2 = Panel("""0
2
4""")

# ----
# Grasshopper
# requires that you
# make space for
# NAN or ffill data
panel_3 = Panel("""a
b
c
d""")

# ----
# Getting Started with Pandas
# into Grasshopper for Rhino3D
# at www.wickersonstudios.com
# Essential functionality
# reindexing_02
series = Series(Start=0, Step="100", Count="5")
# Instructions:
# 1. Drag and drop a hops node on the canvas.
# 2. Set path to:
# http://127.0.0.1:5000/reindexing_ffill_03
# 3. Name and toggle  component name to :
# reindexing_ffill_03
reindexing_ffill_03 = Hops(
    List1=panel,
    Index=panel_2,
    CacheResultsInMemory=True,
    CacheSolveResults=True,
    RemoteDefinitionLocation="http://127.0.0.1:5000/reindexing_ffill_03",
    RemoteSolveVersion=(0, 1, 0),
    ShowInput_Enabled=False,
    ShowInput_Path=False,
    SynchronousSolve=True)
# Instructions:
# 1. Drag and drop a hops node on the canvas.
# 2. Set path to:
# http://127.0.0.1:5000/reindexing_02
# 3. Name and toggle  component name to :
# reindexing_02
reindexing_02 = Hops(
    List1=series,
    Index=panel_3,
    CacheResultsInMemory=False,
    CacheSolveResults=False,
    RemoteDefinitionLocation="http://127.0.0.1:5000/reindexing_02",
    RemoteSolveVersion=(0, 1, 0),
    ShowInput_Enabled=False,
    ShowInput_Path=False,
    SynchronousSolve=True)
panel_4 = Panel(reindexing_ffill_03)
panel_5 = Panel(reindexing_02)
